# Dynamo custom node ClosestPoint.dyf (Dynamo 2.12.0.5650)
# category: RSGBDynamo
# Finds the closest point that is under the max limit input

pointList = Input(pointList: Autodesk.DesignScript.Geometry.Point[]..[])
maxDistance = Input(maxDistance: int)
allPoints = Input(allPoints: Autodesk.DesignScript.Geometry.Point[]..[])
python_script = Python(IN[0]=pointList, IN[1]=maxDistance, IN[2]=allPoints)  # CPython3
# ---------- python_script.python (58 lines) ----------
# Load the Python Standard and DesignScript Libraries
import sys
import clr
clr.AddReference('ProtoGeometry')
from Autodesk.DesignScript.Geometry import *

sys.path.append(r'%AppData%\Roaming\Dynamo\Dynamo Revit\2.12\packages\RSBGDynamo\extra')
import numpy as np

# The inputs to this node will be stored as a list in the IN variables.
pointList = IN[0]
maxDistance = IN[1]
allPoints = IN[2]

###################################################
#This script finds the closest point that is under the max limit input
###################################################

#Create blank lists for the outputs
groupedPoints = []
outOfRangePoints = []

#Loop between the 2 lists
for point in pointList:
    pointDistance = []
    npPoint = np.array((point.X, point.Y, point.Z))
    
    for secondaryPoint in allPoints:
        #Using numpy calculate the euclidean distance 
        npSecondPoint = np.array((secondaryPoint.X, secondaryPoint.Y, secondaryPoint.Z))
        
        #Check are points equal
        if np.array_equal(npPoint, secondaryPoint) == False:
            pointDistance.append(np.linalg.norm(npPoint-npSecondPoint))
            
    try:
        #remove any duplicate points in both lists to ensure the index matches 
        del allPoints[pointDistance.index(0.0)]
        pointDistance.remove(0.0)
    except:
        print("can't remove 0")
        continue
        
    try:
        #check if the min distance isn't greater than the max
        minDistance = min(pointDistance)
        if minDistance < maxDistance:
            indexOfClosestPoint = pointDistance.index(minDistance)
            groupedPoints.append([point, allPoints[indexOfClosestPoint]])
        else:
            outOfRangePoints.append(point)
    except:
        print("An exception occurred finding closest point")
        continue
    

# Assign your output to the OUT variable.
OUT = [groupedPoints, outOfRangePoints]
# ----------------------------------------
code_block = CodeBlock(output=python_script) { output[0]; output[1]; }
groupedPoints = Output(code_block.out0)  # "groupedPoints: Point[]..[]"
outOfRangePoints = Output(code_block.out1)  # "outOfRangePoints: Point[]..[]"
