# Dynamo custom node FindPointsWitinDistance.dyf (Dynamo 2.12.0.5650)
# category: RSGBDynamo.Point
# Find points within a certain distance of another

points = Input(points: Autodesk.DesignScript.Geometry.Point[]..[])
maxDistance = Input(maxDistance: Rhythm.Numbers.Numbers)
python_script = Python(IN[0]=points, IN[1]=maxDistance)  # CPython3
# ---------- python_script.python (46 lines) ----------
# Load the Python Standard and DesignScript Libraries
import sys
import clr
clr.AddReference('ProtoGeometry')
from Autodesk.DesignScript.Geometry import *

#sys.path.append(r'%AppData%\Dynamo\Dynamo Revit\2.12\packages\RSBGDynamo\extra')
import numpy as np
from scipy.spatial import distance

# The inputs to this node will be stored as a list in the IN variables.
pointList = IN[0]
maxDistance = IN[1]

###################################################
#This script finds points that don't have another point 
#with the same coordinates
###################################################

#Create blank lists for the outputs
unconectedPoints = []

i=0
nppointList = []
    
#Loop between the 2 lists
for point in pointList:
    pointDistance = []
    otherPoints = np.delete(pointList, i)
    
    for otherPoint in otherPoints:
        dist = distance.euclidean([point.X, point.Y, point.Z], [otherPoint.X, otherPoint.Y, otherPoint.Z])
        if dist == 0.0:
            print(i)
        pointDistance.append(dist)
        if dist < maxDistance:
            unconectedPoints.append(point)
    
    #if 0.0 not in pointDistance:
        #unconectedPoints.append(point)
    
    i = i+1
    

# Assign your output to the OUT variable.
OUT = unconectedPoints
# ----------------------------------------
points_2 = Output(python_script)  # "points: Point[]..[]"
