# Dynamo custom node GetNearestLevel.dyf (Dynamo 2.12.0.5650)
# category: RSGBDynamo
# A node to get the nearest level to a point based on its z value

levelsList = Input(levelsList: Revit.Elements.Level[]..[])
elevation = Level.Elevation(level=levelsList)
pointZ = Input(pointZ: double[]..[])
python_script = Python(IN[0]=elevation, IN[1]=pointZ)  # CPython3
# ---------- python_script.python (34 lines) ----------
# Load the Python Standard and DesignScript Libraries
import sys
import clr
clr.AddReference('ProtoGeometry')
from Autodesk.DesignScript.Geometry import *

#sys.path.append(r'C:\Users\gwalker\Anaconda3\envs\Dynamo383\Lib\site-packages')

sys.path.append(r'%AppData%\Roaming\Dynamo\Dynamo Revit\2.12\packages\RSBGDynamo\extra')
import numpy as np
# The inputs to this node will be stored as a list in the IN variables.
levelElevation = IN[0]
loadElevation = IN[1]

####################################################
#Code to get the index of the closest level
####################################################

outputList = []

def find_nearest(array, value):     
    array = np.asarray(array);     
    idx = (np.abs(array - value)).argmin();     
    return int(idx);

for load in loadElevation:
    distanceFrom = []
    for level in levelElevation:
        distanceFrom.append(load-level)
    
    outputList.append(find_nearest(distanceFrom, 0))


OUT = outputList
# ----------------------------------------
getItemAtIndex = List.GetItemAtIndex(list=levelsList, index=python_script)
OUT = Output(getItemAtIndex)
